# Grasshopper definition HoloFab_Testing.gh (Grasshopper 1.0.7)
# plug-ins: MeshEdit Components, treesloth01, HoloFab

panel = Panel("199.5.81.93")
panel_2 = Panel("192.168.1.112")
panel_3 = Panel("199.5.80.149")
C = CreateConnection(Address="199.5.81.253")  # -> Connect, Debug
panel_4 = Panel(C.Debug)
number_slider = Slider(426, range=0..1000)  # disabled
number_slider_2 = Slider(740, range=0..1000)
xy = XYPlane(Origin=Point(0, 0, 0))  # disabled
xz = XZPlane(Origin=Point(0, 0, 0))  # disabled
number_slider_3 = Slider(586, range=0..1000)
number_slider_4 = Slider(9, range=3..10)
ui = UIReceiver(Connect=C.Connect)  # -> Toggles, Counters, Sliders
item = ListItem(List=ui.Sliders, Index=0, Wrap=True)  # -> Item, Item1
number_slider_5 = Slider(911, range=0..1000)  # disabled
number_slider_6 = Slider(100, range=0..100)
rectangle = Rectangle(Plane=xy, XSize=number_slider, YSize=number_slider, Radius=0)  # -> Rectangle, Length; disabled
number_slider_7 = Slider(9, range=3..10)
multiplication = Multiplication(A=item.Item, B=100)
robot = ValueList({"Choose Robot", "KR150-2_110", "IRB140", "IRB120"}, selected="IRB120")
genes = GenePool(Decimals=3, Maximum=3.141, Minimum=0, Value=[0.404, 0.212, 0.731, 0.154, 0, 0])  # disabled
genes_2 = GenePool(
    Decimals=3,
    Maximum=3.141,
    Minimum=0,
    Value=[2.429472436, 2.127146699, 2.274348783, 2.94555761, 0.5915926038, 2.364536335])  # disabled
robot_2 = ValueList({"Choose Robot", "KR150-2_110", "IRB140", "IRB120"}, selected="IRB140")
rectangle_2 = Rectangle(Plane=PlaneXY(0, 0, 0), XSize=number_slider_2, YSize=number_slider_2, Radius=0)  # -> Rectangle, Length; disabled
pt = ConstructPoint(XCoordinate=0, YCoordinate=0, ZCoordinate=number_slider_2)
panel_5 = Panel("1")  # disabled
panel_6 = Panel("Hello Nikol")  # disabled
panel_7 = Panel(ui.Counters)
panel_8 = Panel(ui.Toggles)
panel_9 = Panel(ui.Sliders)
pt_2 = ConstructPoint(XCoordinate=Slider(-146, range=-1000..1000), YCoordinate=Slider(0, range=0..1000), ZCoordinate=Slider(0, range=0..1000))
pt_3 = ConstructPoint(XCoordinate=Slider(0, range=0..1000), YCoordinate=Slider(537, range=0..1000), ZCoordinate=Slider(0, range=0..1000))
swatch = ColourSwatch(SwatchColor=RGB(66, 72, 252))
mplane = MeshPlane(Boundary=rectangle.Rectangle, WidthCount=panel_5, HeightCount=panel_5)  # -> Mesh, Area; disabled
panel_10 = Panel("1")  # disabled
msphere = MeshSphere(Base=PlaneXY(0, 0, 0), Radius=number_slider_3, UCount=number_slider_4, VCount=number_slider_4)
msphereex = MeshSphereEx(Base=PlaneXY(0, 0, 0), Radius=number_slider_3, Count=5)  # disabled
sph = Sphere(Base=PlaneXY(0, 0, 0), Radius=number_slider_3)  # disabled
pt_4 = ConstructPoint(XCoordinate=0, YCoordinate=0, ZCoordinate=number_slider_5)  # disabled
msphere_2 = MeshSphere(Base=pt, Radius=multiplication, UCount=number_slider_7, VCount=number_slider_7)
mplane_2 = MeshPlane(Boundary=rectangle_2.Rectangle, WidthCount=panel_10, HeightCount=panel_10)  # -> Mesh, Area; disabled
stack = StackTrees(Data0=genes, Data1=genes_2, Reduce=True)  # disabled
flip = MeshFlip(Mesh=msphere)  # disabled
flip_2 = MeshFlip(Mesh=mplane_2.Mesh)  # disabled
hb = HoloBot(Name=robot, ID=0, Plane=pt_2)
hb_2 = HoloBot(Name=robot_2, ID="1", Plane=pt_3)
ht = HoloTag(TextString=panel_6, TextLocation=pt_4, TextSize=20, TextColor=RGB(255, 255, 255), Connect=C.Connect)  # disabled
mesh_streaming_plus = MeshStreamingPlus(Mesh=msphere_2, Color=ColourSwatch(SwatchColor=RGB(255, 0, 0)), Connect=C.Connect)
mesh = Mesh(msphere)
demesh = DeconstructMesh(Mesh=mesh)  # -> Vertices, Faces, Colours, Normals
panel_11 = Panel("0")  # disabled
booleans = Data(ui.Toggles)  # disabled
pi = Pi(Factor=1)  # disabled
sliders = Data(ui.Sliders)  # disabled
mcol = MeshColours(Mesh=mesh, Colours=demesh.Normals)
item_2 = ListItem(List=booleans, Index=panel_11, Wrap=True)  # disabled
remap = RemapNumbers(Value=sliders, Source=Domain(0, 1), Target=pi)  # -> Mapped, Clipped; disabled
axis_by_branches = Data(stack)  # disabled
filter = StreamFilter(Gate=item_2, Stream0=hb, Stream1=hb_2)  # disabled
ms = MeshStreaming(Mesh=mesh, Color=ColourSwatch(SwatchColor=RGB(255, 0, 0)), Connect=C.Connect)
rc = RobotController(HoloBot=[hb, hb_2], AxisValues=axis_by_branches, Connect=C.Connect)  # disabled
rc_2 = RobotController(HoloBot=filter, AxisValues=remap.Mapped, Connect=C.Connect)  # disabled
rs = RobotStreaming(HoloBotS=[hb_2, hb], Connect=C.Connect)
